# Grasshopper definition Cablenet.gh (Grasshopper 0.9.76)
# plug-ins: K2Engineering, Human, Kangaroo Components, Kangaroo2 Components

# ---- group: Input 10 x 10 m square net
# K2ENGINEERING - CABLENET
mesh = Mesh(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)

# ---- group: K2 form-finding
diag = Diagonalize(Mesh=mesh)
medges = MeshEdges(Mesh=diag)  # -> NakedEdges, InteriorEdges, NonManifoldEdges
number_slider = Slider(100, range=0..1000)
number_slider_2 = Slider(10, range=0..1000)
len = Length(Curve=medges.NakedEdges)
len_2 = Length(Curve=medges.InteriorEdges)
corners = Corners(mesh=mesh)
multiplication = Multiplication(A=len_2, B=Slider(0.4, range=0..1))
multiplication_2 = Multiplication(A=len, B=Slider(0.2, range=0..1))
length_line = LengthLine(Line=medges.InteriorEdges, Length=multiplication, Strength=number_slider_2)
length_line_2 = LengthLine(Line=medges.NakedEdges, Length=multiplication_2, Strength=number_slider)
anchor = Anchor(Point=corners, Strength=10000000)
show = Show(G=corners)
entwine = Entwine(Branch00=show, Branch01=anchor, Branch02=length_line_2, Branch03=length_line, FlattenInputs=True)
solver = Solver(GoalObjects=entwine, Reset=Button(), Threshold=1e-15, Tolerance=0.01, On=Toggle(False))  # -> I, V, O
bang = ExplodeTree(Data=solver.O)  # -> Branch0, Branch1, Branch2, Branch3
supports = Point(bang.Branch0)
ff_edges = Curve(bang.Branch2)

# ----
ff_inner = Curve(bang.Branch3)

# ---- group: K2 form-finding (continued)
previewlw = CustomPreviewLineweights(
    Geometry=[ff_edges, ff_inner],
    Shader=ColourSwatch(SwatchColor=RGB(255, 212, 0)),
    Thickness=Slider(1, range=0..10),
    Absolute=False)

# ---- group: Send form-finding result to structural analysis
structural_analysis = BooleanToggle(False)
filter = StreamFilter(Gate=structural_analysis, Stream1=supports)
filter_2 = StreamFilter(Gate=structural_analysis, Stream1=ff_edges)
filter_3 = StreamFilter(Gate=structural_analysis, Stream1=ff_inner)

# ---- group: Structural analysis
entwine_2 = Entwine(Branch00=multiplication_2, Branch01=multiplication, FlattenInputs=True)
entwine_3 = Entwine(Branch00=number_slider, Branch01=number_slider_2, FlattenInputs=True)
entwine_4 = Entwine(Branch00=filter_2, Branch01=filter_3, FlattenInputs=True)
max_pretension_n = Panel("5.0e3")
len_3 = Length(Curve=entwine_4)
mat = Materials(MaterialIndex=Slider(0, range=0..5))  # -> MaterialName, Density, YoungsModulus, Strength
pt = Pretension(RestLength=entwine_2, Strength=entwine_3, FFLength=len_3, MaxPretension=max_pretension_n)
circle = CircularCS(Diameter=Slider(5, range=0..10))  # -> Area, Inertia, ZDist
circle_2 = CircularCS(Diameter=Slider(3, range=0..10))  # -> Area, Inertia, ZDist
panel = Panel(mat.MaterialName)
bang_2 = ExplodeTree(Data=pt)  # -> Branch0, Branch1
support = Support(PinnedSupportPt=filter, XFixed=True, YFixed=True, ZFixed=True, Strength=1e+15)
cable = Cable(Line=filter_2, EModulus=mat.YoungsModulus, Area=circle.Area, PreTension=bang_2.Branch0)
cable_2 = Cable(Line=filter_3, EModulus=mat.YoungsModulus, Area=circle_2.Area, PreTension=bang_2.Branch1)
entwine_5 = Entwine(Branch00=support, Branch01=cable, Branch02=cable_2, FlattenInputs=True)
solver_2 = Solver(GoalObjects=entwine_5, Reset=Button(), Threshold=1e-15, Tolerance=0.01, On=Toggle(False))  # -> I, V, O
bang_3 = ExplodeTree(Data=solver_2.O)  # -> Branch0, Branch1, Branch2
baroutput = BarOutput(BarData=bang_3.Branch1)  # -> PIndexStart, PIndexEnd, Line, AxialForce, AxialStress
supportoutput = SupportOutput(SupportData=bang_3.Branch0)  # -> SupportPt, ReactionForce
baroutput_2 = BarOutput(BarData=bang_3.Branch2)  # -> PIndexStart, PIndexEnd, Line, AxialForce, AxialStress
vdis = VectorDisplay(Anchor=supportoutput.SupportPt, Vector=supportoutput.ReactionForce)
entwine_6 = Entwine(Branch00=baroutput.Line, Branch01=baroutput_2.Line, FlattenInputs=True)  # -> flatten(Result)
entwine_7 = Entwine(Branch00=baroutput.AxialForce, Branch01=baroutput_2.AxialForce, FlattenInputs=True)  # -> flatten(Result)

# ----
entwine_8 = Entwine(Branch00=baroutput.AxialStress, Branch01=baroutput_2.AxialStress, FlattenInputs=True)  # -> flatten(Result)

# ---- group: Structural analysis (continued)
sort = SortList(Keys=entwine_8)  # -> reverse(Keys), ValuesA
item = ListItem(List=sort.Keys, Index=0, Wrap=True)
max_stress_mpa = Panel(item)
axialdisplay = AxialVisualisation(Line=flatten(entwine_6), AxialStresses=flatten(entwine_8))

# ---- group: Structural analysis / Relates to specified pretension
axial_forces_kn = Panel(entwine_7)

# ==== cluster Corners: Find the boundary corner points of a quad mesh
mesh = ClusterInput()
mesh_2 = Mesh(mesh)
nv = NakedVertices(Mesh=mesh_2)  # -> ClothedIndex, NakedIndex, ClothedPts, NakedPts
vn = VertexNeighbours(Mesh=mesh_2, VertexNumber=nv.NakedIndex)  # -> graft(Vertex), Neighbours, Normal
lng = ListLength(List=vn.Neighbours)
equals = Equality(FirstNumber=lng, SecondNumber=3)  # -> Equality, Inequality
cull = CullPattern(List=vn.Vertex, CullPattern=equals.Inequality)
pshift = ShiftPaths(Data=cull, Offset=-1)
D = ClusterOutput(pshift)
